# Grasshopper definition hops_hui.gh (Grasshopper 1.0.7)
# plug-ins: Weaverbird, Hops, Lionfish, NGon

deconstruct_mesh = DeconstructMesh()  # -> Vertices, Faces, Colours, Normals; disabled
trigger = Trigger(Interval=-1000, TimerInterval=1000)  # disabled
deconstruct = Deconstruct(Point=deconstruct_mesh.Vertices)  # -> flatten(XComponent), flatten(YComponent), flatten(ZComponent); disabled
deconstruct_face = DeconstructFace(Face=deconstruct_mesh.Faces)  # -> flatten(CornerA), flatten(CornerB), flatten(CornerC), flatten(CornerD); disabled
local = Panel("http://localhost:5000/processVF")  # disabled

# ---- group: 1st or 2nd poly
number_slider = Slider(0, range=0..1)

# ----
a_net_diag = BooleanToggle(False)
a_net = BooleanToggle(False)

g_net_diag = BooleanToggle(False)
g_net = BooleanToggle(False)

gga = BooleanToggle(False)
agg = BooleanToggle(False)

aag = BooleanToggle(False)
gaa = BooleanToggle(False)

aagg = BooleanToggle(False)
ggaa = BooleanToggle(True)

mesh = Mesh(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)
local_2 = Panel("http://localhost:5000/processMesh")

# ---- group: minimal_3noid_1_patch_unitscale
mesh_2 = Mesh(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)

# ---- group: a1gnet2_2g+voss+asy_unitscale
mesh_3 = Mesh(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)

# ----
mine = Panel("http://127.0.0.1:5000/processMesh")
florian_s = Panel("http://10.68.74.6:5000/processMesh")
# Inputs
local_3 = Panel("http://localhost:5000/read_1_mesh")

# ---- group: Iterations
# Guided Projection Algorithm Settings
iter = Slider(10, range=5..20)

# ---- group: weight_fairness
fairness = Panel("0.001")
fairness_2 = Panel("0.005")
fairness_3 = Panel("0.0005")
number = Number(fairness_2)

# ---- group: 1st or 2nd poly
number_slider_2 = Slider(0, range=0..1)

# ---- group: weight_self-closeness
closness = Panel("0.01")
closness_2 = Panel("0")
number_2 = Number(closness)

# ---- group: eps
epsilon = Panel("0.001")
number_3 = Number(epsilon)

# ----
panel = Panel("AGG")
panel_2 = Panel("GGA")

panel_3 = Panel("GAA")
panel_4 = Panel("AAG")

panel_5 = Panel("GGAA")

panel_6 = Panel("Anet")
panel_7 = Panel("AnetDiagnet")

panel_8 = Panel("Gnet")
panel_9 = Panel("GnetDiagnet")

# ---- group: input quadmesh
mesh_4 = Mesh(mesh_2)

# ---- group: Optimize
trigger_2 = Trigger(Interval=-1000, TimerInterval=1000, Target=hops)

# ----
point = Point()

# ---- group: web
restart = BooleanToggle(True)
panel_10 = Panel("AAGG")

# ----
# Process
hops = Hops(
    _Path=local_3,
    Mesh=mesh_4,
    Iteration=iter,
    Fairness=number,
    W2Closeness=number_2,
    Direction=number_slider_2,
    Web=panel_10,
    Restart=restart,
    CacheResultsInMemory=False,
    CacheSolveResults=False,
    RemoteDefinitionLocation="http://localhost:5000/read_1_mesh",
    RemoteSolveVersion=(0, 1, 0),
    ShowInput_Enabled=False,
    ShowInput_Path=True,
    SynchronousSolve=True)  # -> Mesh, Vertices, Normal
trigger_3 = Trigger(Interval=-1000, TimerInterval=1000)
hops_2 = Hops(
    CacheResultsInMemory=False,
    CacheSolveResults=False,
    RemoteSolveVersion=(0, 1, 0),
    ShowInput_Enabled=False,
    ShowInput_Path=True,
    SynchronousSolve=True)
hops_3 = Hops(
    CacheResultsInMemory=False,
    CacheSolveResults=False,
    RemoteSolveVersion=(0, 1, 0),
    ShowInput_Enabled=False,
    ShowInput_Path=True,
    SynchronousSolve=True)
hops_4 = Hops(
    CacheResultsInMemory=False,
    CacheSolveResults=False,
    RemoteSolveVersion=(0, 1, 0),
    ShowInput_Enabled=False,
    ShowInput_Path=True,
    SynchronousSolve=True)
hops_5 = Hops(
    CacheResultsInMemory=False,
    CacheSolveResults=False,
    RemoteSolveVersion=(0, 1, 0),
    ShowInput_Enabled=False,
    ShowInput_Path=True,
    SynchronousSolve=True)
hops_6 = Hops(
    CacheResultsInMemory=False,
    CacheSolveResults=False,
    RemoteSolveVersion=(0, 1, 0),
    ShowInput_Enabled=False,
    ShowInput_Path=True,
    SynchronousSolve=True)
hops_7 = Hops(
    CacheResultsInMemory=False,
    CacheSolveResults=False,
    RemoteSolveVersion=(0, 1, 0),
    ShowInput_Enabled=False,
    ShowInput_Path=True,
    SynchronousSolve=True)
hops_8 = Hops(
    CacheResultsInMemory=False,
    CacheSolveResults=False,
    RemoteSolveVersion=(0, 1, 0),
    ShowInput_Enabled=False,
    ShowInput_Path=True,
    SynchronousSolve=True)
hops_9 = Hops(
    CacheResultsInMemory=False,
    CacheSolveResults=False,
    RemoteSolveVersion=(0, 1, 0),
    ShowInput_Enabled=False,
    ShowInput_Path=True,
    SynchronousSolve=True)
hops_10 = Hops(
    CacheResultsInMemory=False,
    CacheSolveResults=False,
    RemoteSolveVersion=(0, 1, 0),
    ShowInput_Enabled=False,
    ShowInput_Path=True,
    SynchronousSolve=True)
hops_11 = Hops(
    CacheResultsInMemory=False,
    CacheSolveResults=False,
    RemoteSolveVersion=(0, 1, 0),
    ShowInput_Enabled=False,
    ShowInput_Path=True,
    SynchronousSolve=True)

# ---- group: vertices
point_2 = Point(hops.Vertices)

# ---- group: normal
vector = Vector(hops.Normal)

# ---- group: output quadmesh
# Outputs
mesh_5 = Mesh(hops.Mesh)

# ----
hops_12 = Hops(
    CacheResultsInMemory=False,
    CacheSolveResults=False,
    RemoteSolveVersion=(0, 1, 0),
    ShowInput_Enabled=False,
    ShowInput_Path=True,
    SynchronousSolve=True)
hops_13 = Hops(
    CacheResultsInMemory=False,
    CacheSolveResults=False,
    RemoteSolveVersion=(0, 1, 0),
    ShowInput_Enabled=False,
    ShowInput_Path=True,
    SynchronousSolve=True)
hops_14 = Hops(
    CacheResultsInMemory=False,
    CacheSolveResults=False,
    RemoteSolveVersion=(0, 1, 0),
    ShowInput_Enabled=False,
    ShowInput_Path=True,
    SynchronousSolve=True)
hops_15 = Hops(
    CacheResultsInMemory=False,
    CacheSolveResults=False,
    RemoteSolveVersion=(0, 1, 0),
    ShowInput_Enabled=False,
    ShowInput_Path=True,
    SynchronousSolve=True)

# ----
# check geodesic between two vertices by <> way
naked_vertices = NakedVertices(Mesh=mesh_5)  # -> Vertices, Status
list_item = ListItem(List=naked_vertices.Vertices, Index="38", Wrap=True)
list_item_2 = ListItem(List=naked_vertices.Vertices, Index="73", Wrap=True)
geodesiccurves = GeodesicCurves(Mesh=mesh_5, StartPoint=list_item_2, EndPoint=list_item)

weaverbird_s_naked_boundary = WeaverbirdsNakedBoundary()

# ----
# Optimized mesh vertex-normals
weaverbird_s_mesh_edges = WeaverbirdsMeshEdges(MeshOrPolylines=mesh_5)
length = Length(Curve=weaverbird_s_mesh_edges)
# Visulization
average = Average(Input=length)
amplitude = Amplitude(Vector=vector, Amplitude=average)
addition = Addition(A=point_2, B=amplitude)
line = Line(StartPoint=point_2, EndPoint=addition)

local_4 = Panel("http://localhost:5000/bezier__spline")

# ----
# get 2 ctrl-polylines + 2 diag-polylines
local_5 = Panel("http://localhost:5000/polyline_4_directions")
trigger_4 = Trigger(Interval=-1000, TimerInterval=1000, Target=hops_16)
hops_16 = Hops(
    _Path=local_5,
    Mesh=mesh_5,
    CacheResultsInMemory=False,
    CacheSolveResults=False,
    RemoteDefinitionLocation="http://localhost:5000/polyline_4_directions",
    RemoteSolveVersion=(0, 1, 0),
    ShowInput_Enabled=False,
    ShowInput_Path=True,
    SynchronousSolve=True)  # -> Polyline1, Polyline2, Polyline3, Polyline4
line_2 = Line(hops_16.Polyline2)
line_3 = Line(hops_16.Polyline4)
line_4 = Line(hops_16.Polyline1)
line_5 = Line(hops_16.Polyline3)

trigger_5 = Trigger(Interval=-1000, TimerInterval=1000, Target=hops_18)

# ---- group: weight_Bezier-Ctrl-Pts
panel_11 = Panel("0.005")
panel_12 = Panel("0.05")
number_4 = Number("0.01")

# ----
# checker vertices
local_6 = Panel("http://localhost:5000/checker_tianvertex")
trigger_6 = Trigger(Interval=-1000, TimerInterval=1000, Target=hops_17)
hops_17 = Hops(
    _Path=local_6,
    Mesh=mesh_5,
    CacheResultsInMemory=False,
    CacheSolveResults=False,
    RemoteDefinitionLocation="http://localhost:5000/checker_tianvertex",
    RemoteSolveVersion=(0, 1, 0),
    ShowInput_Enabled=False,
    ShowInput_Path=True,
    SynchronousSolve=True)  # -> P1, P2
point_3 = Point(hops_17.P2)
point_4 = Point(hops_17.P1)

# ---- group: ith-poly
panel_13 = Panel("1")
panel_14 = Panel("3")
panel_15 = Panel("4")
integer = Integer("2")

# ----
checker_vertices = BooleanToggle(False)
hops_18 = Hops(
    _Path=local_4,
    Mesh=mesh_5,
    Web=panel_10,
    VN=vector,
    Ipoly=integer,
    Weight=number_4,
    Checker=checker_vertices,
    CacheResultsInMemory=False,
    CacheSolveResults=False,
    RemoteDefinitionLocation="http://localhost:5000/bezier__spline",
    RemoteSolveVersion=(0, 1, 0),
    ShowInput_Enabled=False,
    ShowInput_Path=True,
    SynchronousSolve=True)  # -> CtrlP, Indices, Bezier, An, E1, E2, E3, R
curve = Curve(hops_18.Bezier)

# ---- group: v
point_5 = Point(hops_18.An)

# ---- group: allP
point_6 = Point(hops_18.CtrlP)

# ---- group: e1
vector_2 = Vector(hops_18.E1)

# ---- group: e3
vector_3 = Vector(hops_18.E3)

# ---- group: r
vector_4 = Vector(hops_18.R)

# ---- group: e2
vector_5 = Vector(hops_18.E2)

# ----
# unit principal normal E2
amplitude_2 = Amplitude(Vector=vector_5, Amplitude=average)
addition_2 = Addition(A=point_5, B=amplitude_2)
line_6 = Line(StartPoint=point_5, EndPoint=addition_2)

# ----
# unit tangent E1
amplitude_3 = Amplitude(Vector=vector_2, Amplitude=average)
addition_3 = Addition(A=point_5, B=amplitude_3)
line_7 = Line(StartPoint=point_5, EndPoint=addition_3)

# ----
# unit Darboux(ruling) r
amplitude_4 = Amplitude(Vector=vector_4, Amplitude=average)
addition_4 = Addition(A=point_5, B=amplitude_4)
line_8 = Line(StartPoint=point_5, EndPoint=addition_4)

# ----
# unit binormal E3
amplitude_5 = Amplitude(Vector=vector_3, Amplitude=average)
addition_5 = Addition(A=point_5, B=amplitude_5)
line_9 = Line(StartPoint=point_5, EndPoint=addition_5)

# ----
# reshape a list
list_length = ListLength()  # disabled
list_item_3 = ListItem(Index=0, Wrap=True)  # disabled
multiplication = Multiplication(A=list_item_3, B=list_length)  # disabled
series = Series(Start=0, Step=1, Count=multiplication)  # disabled
partition_list = PartitionList(List=series, Size=list_item_3)  # -> simplify(Chunks); disabled

# ----
# control_points + Bezier_splines
list_item_4 = ListItem(List=point_6, Index=partition_list, Wrap=True)  # disabled
control_points = Point(list_item_4)  # disabled
panel_16 = Panel("5")  # disabled
nurbs_curve = NurbsCurve(Vertices=control_points, Degree=panel_16, Periodic=False)  # -> Curve, Length, Domain; disabled
